# Grasshopper definition JSON Example.ghx (Grasshopper 0.9.75)
# plug-ins: ghJSON

series = Series(Start=0, Step=1, Count=4)
child = GetChild(Parent="$", ObjectName="store")
int = Integer(series)
child_2 = GetChild(Parent=child, ObjectName="book")
element = GetElement(C=child_2, I=int)
panel = Panel("""{ "store": {
  "book": [ 
  { "category": "reference",
  "author": "Nigel Rees",
  "title": ["Sayings of the Century", "test"],
  "price": 8.95
  },
  { "category": "fiction",
  "author": "Evelyn Waugh",
  "title": ["Sword of Honour"],
  "price": 12.99
  },
  { "category": "fiction",
  "author": "Herman Melville",
  "title": ["Moby Dick"],
  "isbn": "0-553-21311-3",
  "price": 8.99
  },
  { "category": "fiction",
  "author": "J. R. R. Tolkien",
  "title": ["The Lord of the Rings"],
  "isbn": "0-395-19395-8",
  "price": 22.99
}
],
"bicycle": {
  "color": "red",
  "price": 19.95
}
}
}""")
child_3 = GetChild(Parent=element, ObjectName="title")
allchldrn = GetAllChildren(Parent=child_3)
fromjson = FromJSON(JSON=panel)
panel_2 = Panel(fromjson)
jpath = JPath(JObject=fromjson, JPathQuery=allchldrn)
panel_3 = Panel(jpath)
